# Grasshopper definition Day1.gh (Grasshopper 1.0.7)

# DeCasteljauAlgorithm
number_slider = Slider(0.26, range=0.01..1)
curve = Curve(reparameterize(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))
point = Point([Point(-15.68717932, -11.71483186, 0), Point(-5.474729209, 14.53982706, 0), Point(11.39020952, -16.86131729, 0), Point(21.89493407, 19.12448436, 0), Point(40.92752445, 3.950505155, 0)])
c_script = CSharpScript(curve=curve, tolerance=number_slider)  # -> out, outputSegments; inputs curve: Curve, tolerance: Double
# ---------- c_script: C# ----------
    List<LineCurve> segments = new List<LineCurve>();
    DivideCurve(curve, 0.0, 1.0, tolerance, segments);
    outputSegments = segments;
# ---------- c_script: C# additional code ----------
  void DivideCurve(Curve curve, double tStart, double tEnd, double tolerance, List<LineCurve> segments)
  {
    Point3d startPoint = curve.PointAt(tStart);
    Point3d endPoint = curve.PointAt(tEnd);
    Point3d middlePoint = 0.5 * (startPoint + endPoint);

    double tClosest;
    curve.ClosestPoint(middlePoint, out tClosest);

    double distance = curve.PointAt(tClosest).DistanceTo(middlePoint);

    if(distance < tolerance)
      segments.Add(new LineCurve(startPoint, endPoint));
    else
    {
      double tMiddle = 0.5 * (tStart + tEnd);
      DivideCurve(curve, tStart, tMiddle, tolerance, segments);
      DivideCurve(curve, tMiddle, tEnd, tolerance, segments);
    }


  }
# ---------- end c_script ----------
c_script_2 = CSharpScript()  # -> out, A
# ---------- c_script_2: C# ----------
    Random myRandomGenerator = new Random();//括号中可以输入参数seed，如果不指定seed，则会自动根据系统的时钟生成

    for(int i = 0;i < 10;i++)
    {
      double myRandomNumber = myRandomGenerator.NextDouble();//返回0-1之间的随机double数，如果想要0-13.5之间的就*13.5
      
      double a = myRandomNumber * 6 - 3;//返回-3到3之间的随机double数
      
      Print(myRandomNumber.ToString());
    }
# ---------- end c_script_2 ----------
point_2 = Point([Point(-7.14606524, -3.245882489, 0), Point(-7.14606524, 10.3738791, 0), Point(-7.14606524, 18.12680552, 0), Point(22.76475447, 18.12680552, 0), Point(22.76475447, -6.142719329, 0), Point(0.02500870355, -6.142719329, 0), Point(0.02500870355, 9.249413509, 0), Point(9.981301799, 9.249413509, 0), Point(9.981301799, -3.874843306, 0), Point(4.0553047, -3.874843306, 0), Point(4.0553047, 4.906047596, 0), Point(14.65194975, 4.906047596, 0)])
c_script_3 = CSharpScript(controlPoints=point, iterationCount=Slider(7, range=0..10))  # -> out, curve; inputs controlPoints: list of Point3d, iterationCount: Int32
# ---------- c_script_3: C# ----------
    for(int j = 0;j < iterationCount;j++)
    {
      List<Point3d> newControlPoints = new List<Point3d>();
      for(int i = 0;i < controlPoints.Count - 1;i++)
      {
        Point3d oneQuarterPoint = 0.75 * controlPoints[i] + 0.25 * controlPoints[i + 1];
        newControlPoints.Add(oneQuarterPoint);

        Point3d threeQuarterPoint = 0.25 * controlPoints[i] + 0.75 * controlPoints[i + 1];
        newControlPoints.Add(threeQuarterPoint);
      }

      controlPoints = newControlPoints;
    }

    curve = new PolylineCurve(controlPoints);
# ---------- end c_script_3 ----------

c_script_4 = CSharpScript()  # -> out, A
# ---------- c_script_4: C# ----------
    List<string> myTexts = new List<string>();
    Print(myTexts.Count.ToString());
    Foo(myTexts);
    Print(myTexts.Count.ToString());
# ---------- c_script_4: C# additional code ----------
  void Foo(List<string> texts)
  {
    texts.Add("Oh,Yeah!!!");
  }
# ---------- end c_script_4 ----------
c_script_5 = CSharpScript()  # -> out, A
# ---------- c_script_5: C# ----------
    double myNumber = 2.0;
    Foo(myNumber);
    Print(myNumber.ToString());
# ---------- c_script_5: C# additional code ----------
  void Foo(double someNumber)
  {
    someNumber = someNumber + 1.0;
  }
# ---------- end c_script_5 ----------

c_script_6 = CSharpScript()  # -> out, A
# ---------- c_script_6: C# ----------
    double result = ComputeCylinderVolume(2.0, 2.0);
    Print(result.ToString());
# ---------- c_script_6: C# additional code ----------
  double ComputeCylinderVolume(double r, double h)
  {
    return 3.14 * r * r * h;
  }
# ---------- end c_script_6 ----------
c_script_7 = CSharpScript()  # -> out, A
# ---------- c_script_7: C# ----------
    double result = ComputeCylinderVolume(2.0, 2.0);
    Print(result.ToString());
# ---------- c_script_7: C# additional code ----------
  double ComputeCylinderVolume(double r, double h)
  {
    double baseArea = ComputeCircleArea(r);
    return baseArea * h;
  }

  double ComputeCircleArea(double r)
  {
    return r * r * 3.14;
  }
# ---------- end c_script_7 ----------

c_script_8 = CSharpScript(points=point_2)  # -> out, A; inputs points: list of Point3d
# ---------- c_script_8: C# ----------
    List<Circle> circles = new List<Circle>();
    
    foreach (Point3d point in points)
    {
      Circle circle = new Circle(point, 2.0);
      circles.Add(circle);
    }
    A = circles;
# ---------- end c_script_8 ----------
c_script_9 = CSharpScript(x=Slider(1, range=0..1), y=Slider(0.6, range=0..1), z=Slider(0.6, range=0..1))  # -> out, A, B; inputs x: Double, y: Double, z: Double
# ---------- c_script_9: C# ----------
    A = x + y;
    B = x + y + z;
# ---------- end c_script_9 ----------
c_script_10 = CSharpScript()  # -> out, A
# ---------- c_script_10: C# ----------
    Point3d myPoint = new Point3d(1.0, 2.0, 3.0);
    A = myPoint;
# ---------- end c_script_10 ----------
c_script_11 = CSharpScript()  # -> out, A
# ---------- c_script_11: C# ----------
    List<Point3d> myPoints = new List<Point3d>();
    //myPoints.Add(new Point3d(2.0, 1.0, 2.0));//向myPoints列表中添加一个点
    //myPoints.Add(new Point3d(2.0, 1.0, 5.0));

    //for(int i = 0;i < 100;i++)
    //{
    //  Point3d point = new Point3d(i, i, i);
    //  myPoints.Add(point);
    //}

    for(int i = 0;i < 100;i++)
    {
      for(int j = 0;j < 20;j++)
      {
        myPoints.Add(new Point3d(i, j, 0));
      }
    }

    A = myPoints;
# ---------- end c_script_11 ----------
panel = Panel(c_script_2.out)
panel_2 = Panel(c_script_9.A)
